% Simulink data dictionary Quad.sldd

theta1 = Simulink.Parameter(45, Unit="deg")
theta2 = Simulink.Parameter(135, Unit="deg")
theta3 = Simulink.Parameter(225, Unit="deg")
theta4 = Simulink.Parameter(315, Unit="deg")
L_arm = Simulink.Parameter(0.225, Unit="m")
hub_dims = Simulink.Parameter([0.114 0.114 0.055], Unit="m")
m_hub = Simulink.Parameter(0.455, Unit="kg")
h_motor = Simulink.Parameter(0.03, Unit="m")
r_motor = Simulink.Parameter(0.014, Unit="m")
m_arm = Simulink.Parameter(0.05, Unit="kg")
arm_dims = Simulink.Parameter([0.22 0.04 0.02], Unit="m")
m_motor = Simulink.Parameter(0.057, Unit="kg")
m_prop = Simulink.Parameter(0.013, Unit="kg")
prop_dims = Simulink.Parameter([0.254 0.02 0.005], Unit="m")
r_arm_in = Simulink.Parameter(0.03, Unit="m")
z_cg = Simulink.Parameter(Simulink.data.Expression(ExpressionString="com(3)"), Unit="m")  % hight of com above the center, measured with inertia sensor